# Grasshopper definition Cantilever.gh (Grasshopper 1.0.8)
# Copyright: hrntsm
# plug-ins: Lemur Info, IguanaMesh

number_slider = Slider(2, range=0..100)
ilineartetraprism = ILinearTetraPrism(
    MinimumSize=number_slider,
    MaximunSize=number_slider,
    CurvatureAdapt=False,
    MinimumElements=6,
    Optimization=0,
    QualityType=2,
    QualityThreshold=0.3,
    Massive_Refinement=False)
brep = Brep(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)
debrep = DeconstructBrep(Brep=brep)  # -> Faces, Edges, Vertices
ifillbrep = IFillBrep(Brep=brep, ISettings=ilineartetraprism)  # -> IMesh, Entities, Info
item = ListItem(List=debrep.Faces, Index=Slider(3, range=0..5), Wrap=True)
lefi = LeMeshFromIMesh(Header="Cantilever", IMesh=ifillbrep.IMesh)  # -> LeMesh, Mesh
conlecnt = ConstructLeControl()
conleasm = ConstructLeAssemble(LeMesh=lefi.LeMesh, LeCnt=conlecnt)
congrpsurf = ConstructGroupFromSurface(LeMesh=lefi.LeMesh, Surface=item, GroupType=Slider(2, range=0..2), Tolerance=1e-06)  # -> Group, Geometry
path = FilePath("C:\Users\hiroa\Desktop\lemur_test\")
leexe = LeExecute(LeAssemble=conleasm, Thread="-1", Dir=path, Run=Toggle(False))
previn = PreviewInput(LeAssemble=conleasm)  # -> Msh, Control, Hec; disabled
panel = Panel(previn.Hec)
panel_2 = Panel(previn.Control)
panel_3 = Panel(previn.Msh)
